% Simulink data dictionary obstacleAvoidance_data.sldd

TimeStep = Simulink.Parameter(0.02)
obstacleAvoid_controller = Simulink.ConfigSet(StartTime="0", StopTime="10", FixedStep="TimeStep", Solver="FixedStepDiscrete", ProdHWDeviceType="Intel->x86-64 (Windows64)", SystemTargetFile="ert.tlc", TargetLang="C")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
obstacleAvoid_controller_PIL = Simulink.ConfigSet(StartTime="0", StopTime="10", FixedStep="TimeStep", Solver="FixedStepDiscrete", ProdHWDeviceType="ARM Compatible->ARM Cortex", SystemTargetFile="ert.tlc", HardwareBoard="STM32 Nucleo H743ZI2", TargetLang="C")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